# Grasshopper definition pattern-generator.gh (Grasshopper 1.0.7)
# plug-ins: LunchBox, Pufferfish

list = ValueList({"Straight": 1, "Bowling Pin": 2, "Brackets": 3, "Cross": 4}, selected="Straight")
crv = Curve(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)
crv_2 = Curve(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)
crv_3 = Curve(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)
crv_4 = Curve(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)
python = GhPythonScript(crv=list, straight=crv, bowling=crv_2, bracket=crv_3, cross=crv_4)  # -> out, a; inputs crv: Int32, straight: Curve, bowling: Curve, bracket: Curve, cross: Curve
# ---------- python: Python ----------
if crv == 1:
    a = straight
elif crv == 2:
    a = bowling
elif crv == 3:
    a = bracket
elif crv == 4:
    a = cross
# ---------- end python ----------
dom = ConstructDomain(DomainStart=0, DomainEnd=30)
dom_2 = ConstructDomain(DomainStart=0, DomainEnd=50)
crv_5 = Curve(python.a)
rectangle = Rectangle(Plane=PlaneXY(0, 0, 0), XSize=dom, YSize=dom_2, Radius=0)  # -> Rectangle, Length
rectangle_2 = Rectangle(Plane=PlaneXY(0, 0, 0), XSize=dom, YSize=Domain(0, 110), Radius=0)  # -> Rectangle, Length
area = Area(Geometry=rectangle.Rectangle)  # -> Area, Centroid
area_2 = Area(Geometry=crv_5)  # -> Area, Centroid
scale_nu = ScaleNU(
    Geometry=rectangle.Rectangle,
    Plane=area.Centroid,
    ScaleX=Slider(1.1, range=0..10),
    ScaleY=Slider(1.3, range=0..10),
    ScaleZ=1)  # -> Geometry, Transform
boundary = BoundarySurfaces(Edges=scale_nu.Geometry)
scale_nu_2 = ScaleNU(Geometry=crv_5, Plane=area_2.Centroid, ScaleX=Slider(0.43, range=0..2), ScaleY=Slider(0.4, range=0..2), ScaleZ=1)  # -> Geometry, Transform
dgrid = DiamondGrid(Surface=boundary, UDivisions=Slider(14, range=0..100), VDivisions=Slider(60, range=0..200))  # -> CornerPoint1, CornerPoint2, CornerPoint3, CornerPoint4, MidPoint, Normals
pt = Point(dgrid.MidPoint)
move2pt = MoveToPoint(Geometry=scale_nu_2.Geometry, PointA=area_2.Centroid, PointB=pt)  # -> Moved, Vector, Transform
trim = TrimWithRegion(Curve=move2pt.Moved, Region=rectangle.Rectangle)  # -> Inside, Outside
merge = Merge(Data1=trim.Inside, Data2=rectangle_2.Rectangle)
crv_6 = Curve(flatten(merge))
